% Simulink data dictionary InterfaceDictionary.sldd

CoolingFreshWater = Simulink.Bus()
CompressedAir = Simulink.Bus()
FuelOil = Simulink.Bus()
LubeOil = Simulink.Bus()
SaltWater = Simulink.Bus()
WasteGas = Simulink.Bus()
WasteWater = Simulink.Bus()
WasteSolid = Simulink.Bus()
Control = Simulink.Bus()
Power = Simulink.Bus()
Physical = Simulink.Bus()