% Requirement links of test_ExistComp_01.m (R2026a)

% lines 6-63 verifies ShipRequirements.slreqx#47
function test_VerifyComponentExistsAndIsActive(testCase)
    % --- CONFIGURATION ---
    modelName = 'SYSTEM'; % Top-level model name
    
    if ~bdIsLoaded(modelName)
        load_system(modelName);
    end

    % 1. LOCATE LINKED REQUIREMENT VIA HELPER
    linkedReq = fetchLinkedRequirement();
    testCase.verifyNotEmpty(linkedReq, ...
        'Verification Failed: Could not resolve a linked requirement for this test script.');

    % 2. READ & CLEAN CUSTOM ATTRIBUTE
    rawTarget = string(linkedReq.getAttribute('PerfVal1'));
    componentName = erase(strtrim(rawTarget), ["'", '"']); % Strips quotes and whitespace
    
    testCase.verifyNotEmpty(componentName, ...
        sprintf('Requirement ID "%s" Failed: "PerfVal1" custom attribute is empty.', linkedReq.Id));

    [~, cleanBlockName] = fileparts(componentName);

    % 3. SEARCH MODEL FOR ALL INSTANCES (Active + Inactive)
    foundAll = find_system(modelName, ...
        'MatchFilter', @Simulink.match.allVariants, ...
        'Name', cleanBlockName);

    if isempty(foundAll) && contains(componentName, '/')
        if bdIsLoaded(strtok(componentName, '/'))
            foundAll = find_system(modelName, ...
                'MatchFilter', @Simulink.match.allVariants, ...
                'Path', componentName);
        end
    end

    % FAIL CONDITION 1: Component does not exist anywhere in the model
    testCase.verifyNotEmpty(foundAll, ...
        sprintf('Requirement ID "%s" Failed: Component "%s" does not exist anywhere in model "%s".', ...
        linkedReq.Id, cleanBlockName, modelName));

    if isempty(foundAll)
        return;
    end

    % 4. VERIFY ACTIVE STATUS AT EDIT-TIME
    hasActiveInstance = false;
    for k = 1:length(foundAll)
        if isBlockActiveAtEditTime(foundAll{k})
            hasActiveInstance = true;
            break;
        end
    end

    % FAIL CONDITION 2: Component exists, but is an inactive variant choice
    testCase.verifyTrue(hasActiveInstance, ...
        sprintf('Requirement ID "%s" Failed: Component "%s" exists in model "%s", but it is currently an INACTIVE variant choice.', ...
        linkedReq.Id, cleanBlockName, modelName));
end