% Requirement links of test_fuelEndurance.m (R2026a)

% lines 1-241 verifies ShipRequirements.slreqx#14
% lines 1-241 verifies ShipRequirements.slreqx#15
function tests = test_fuelEndurance
    tests = functiontests(localfunctions);
end

function test_UsableFuelInventoryEndurance(testCase)
    modelName = 'SYSTEM';
    
    % Checks if Model is Open, and opens the model if it is closed
    if ~bdIsLoaded(modelName)
        open_system(modelName);
    end
    
    % Creating Model Object
    modelObj = systemcomposer.loadModel(modelName);
    
    % Target Requirement (Days)
    totalEndurance = 100; % days
    
    % Unit Conversion Factor: 86,400 seconds in 1 day
    SECONDS_PER_DAY = 86400; 
    
    % Stereotype and Property Names
    consumerStereotype = 'FuelConsumer';
    compFuelProp       = 'FuelType';                            
    compRateProp       = 'FuelRequired'; % Expects flow rate in m^3/s
    
    tankStereotype     = 'Tank';        
    primaryCapProp     = 'PrimaryFluidCapacity';   % Expects capacity in m^3
    secondaryCapProp   = 'SecondaryFluidCapacity'; % Expects capacity in m^3
    tertiaryCapProp    = 'TertiaryFluidCapacity';  % Expects capacity in m^3
    
    tankPrimaryFluid   = 'PriFluid';
    tankSecondaryFluid = 'SecFluid';
    tankTertiaryFluid  = 'TerFluid';

    % Get All Model Components Recursively (Inline Queue)
    allComps = systemcomposer.arch.Component.empty;
    
    if ~isempty(modelObj.Architecture)
        queue = modelObj.Architecture.Components;
        
        while ~isempty(queue)
            c = queue(1);
            queue(1) = []; % Pop top component
            
            allComps(end+1) = c; %#ok<AGROW>
            
            if ~isempty(c.Architecture) && ~isempty(c.Architecture.Components)
                queue = [queue, c.Architecture.Components]; %#ok<AGROW>
            end
        end
    end

    % 1. Query Tank Capacities per Fluid Type (Active Components Only)
    tankCapacities = containers.Map('KeyType', 'char', 'ValueType', 'double');

    for i = 1:length(allComps)
        c = allComps(i);
        
        % Robust Stereotype Check
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